# Dynamo custom node AreaPlan.ByLevelName.dyf (Dynamo 0.8.2.2392)
# category: SpringNodes.Revit.Views
# Creates an area plan at the designated levels. Each new view needs a name. An area scheme must first be activated before it can be used. To activate a scheme, place one view of that type in the project(you can then delete it).  If a view with the same scheme and name exists, you'll get a null instead.

level_s = Input()  # "level(s)"
name_s = Input()  # "name(s)"
scheme_name = Input()
python_script = Python(IN[0]=level_s, IN[1]=name_s, IN[2]=scheme_name)
# ---------- python_script.python (48 lines) ----------
import clr

clr.AddReference('RevitServices')
from RevitServices.Persistence import DocumentManager
from RevitServices.Transactions import TransactionManager
doc = DocumentManager.Instance.CurrentDBDocument

clr.AddReference('RevitNodes')
import Revit
clr.ImportExtensions(Revit.Elements)

clr.AddReference('RevitAPI')
from Autodesk.Revit.DB import *

def tolist(obj1):
	if hasattr(obj1,'__iter__'): return obj1
	else: return [obj1]
def output1(l1):
	if len(l1) == 1: return l1[0]
	else: return l1
	
lvls = UnwrapElement(tolist(IN[0]) )
names = tolist(IN[1])
plan_type = IN[2]
#fail_str = 'view with same name exists'
vt1 = None # fetch a area plan type
fec1 = FilteredElementCollector(doc).OfClass(ViewFamilyType)
for f in fec1:
	if Element.Name.__get__(f) == plan_type :
		vt1 = f.Id
		break

fec2 = FilteredElementCollector(doc).OfClass(View) #get area plan names
plan_names = [f.Name for f in fec2 if f.GetTypeId().Equals(vt1)]

if vt1 != None:
	out1 = []
	TransactionManager.Instance.EnsureInTransaction(doc)
	for l, n in zip(lvls, names):
		if n not in plan_names:
			v1 = ViewPlan.Create(doc, vt1, l.Id)
			v1.Name = n
			out1.append(v1.ToDSType(False) )
		else : out1.append(None)
	TransactionManager.Instance.TransactionTaskDone()
	OUT = output1(out1)

else : OUT = "AreaPlan type is either inactive or does not exist."
# ----------------------------------------
AreaPlan = Output(python_script)
