# Dynamo custom node Collector.CurrentSelection.dyf (Dynamo 0.8.2.2392)
# category: SpringNodes.Revit.Collectors
# Gets the currently selected elements. Connect a boolean switch to refresh the selection.

refresh = Input(refresh:bool = true)
python_script = Python(IN[0]=refresh)
# ---------- python_script.python (16 lines) ----------
import clr

clr.AddReference("RevitNodes")
import Revit
clr.ImportExtensions(Revit.Elements)

clr.AddReference("RevitServices")
import RevitServices
from RevitServices.Persistence import DocumentManager
uiapp = DocumentManager.Instance.CurrentUIApplication
uidoc=uiapp.ActiveUIDocument

bool = IN[0]
not1 = not bool
sel=uidoc.Selection.Elements
OUT =[s.ToDSType(True) for s in sel]
# ----------------------------------------
element_s = Output(python_script)  # "element(s)"
