# Dynamo custom node Collector.ElementsInView.dyf "Springs.Collector.ElementsInView" (Dynamo 1.2.1.3083)
# category: Springs.Revit.Collectors
# Selects all elements visible in the input view.

view = Input(view:var[])
category = Input(category:var = null)
refresh = Input(refresh:bool = true)
python_script = Python(IN[0]=view, IN[1]=category, IN[2]=refresh)
# ---------- python_script.python (39 lines) ----------
#Copyright(c) 2016, Dimitar Venkov
# @5devene, dimitar.ven@gmail.com

import clr

clr.AddReference("RevitServices")
import RevitServices
from RevitServices.Persistence import DocumentManager
doc = DocumentManager.Instance.CurrentDBDocument

clr.AddReference("RevitAPI")
from Autodesk.Revit.DB import FilteredElementCollector

clr.AddReference("RevitNodes")
import Revit
clr.ImportExtensions(Revit.Elements)

def tolist(obj1):
	if hasattr(obj1,"__iter__"): return obj1
	else: return [obj1]
def output1(l1):
	if len(l1) == 1: return l1[0]
	else: return l1

views = UnwrapElement(tolist(IN[0]) )
cat = UnwrapElement(IN[1])
elements = []

for i in xrange(len(views)):
	if cat is not None:
		fec = FilteredElementCollector(doc, views[i].Id).WhereElementIsNotElementType().OfCategoryId(cat.Id).GetElementIterator()
	else:
		fec = FilteredElementCollector(doc, views[i].Id).WhereElementIsNotElementType().GetElementIterator()
	fec.Reset()
	view_el = []
	while fec.MoveNext():
		view_el.append(fec.Current.ToDSType(True) )
	elements.append(view_el)
OUT = output1(elements)
# ----------------------------------------
element_s = Output(python_script)  # "element(s)"
