# Dynamo custom node Collector.LinkedInstanceElements.dyf "Springs.Collector.LinkedInstanceElements" (Dynamo 0.8.2.2392)
# category: Springs.Revit.Collectors
# Extract elements by category from the selected linked instances. The transform vector can be used to get the exact location of the elements in the local file

LinkInstance = Input(LinkInstance:var[])
category = Input(category:Category)
refresh = Input(refresh:bool = true)
python_script = Python(IN[0]=LinkInstance, IN[1]=category, IN[2]=refresh)
# ---------- python_script.python (39 lines) ----------
#Copyright(c) 2016, Dimitar Venkov
# @5devene, dimitar.ven@gmail.com
#original design by Julien Benoit, @jbenoit44
# http://aecuandme.wordpress.com/

import clr
clr.AddReference('ProtoGeometry')
from Autodesk.DesignScript.Geometry import *

clr.AddReference("RevitNodes")
import Revit
clr.ImportExtensions(Revit.Elements)
clr.ImportExtensions(Revit.GeometryConversion)

clr.AddReference("RevitAPI")
import Autodesk
from Autodesk.Revit.DB import FilteredElementCollector, ElementCategoryFilter, XYZ

def tolist(obj1):
	if hasattr(obj1,"__iter__"): return obj1
	else: return [obj1]
def output1(l1):
	if len(l1) == 1: return l1[0]
	else: return l1

Link1 = UnwrapElement(tolist(IN[0]))
Cat1 = UnwrapElement(IN[1])
elements, transforms = [], []

for i in xrange(len(Link1)):
	LinkDoc = Link1[i].GetLinkDocument()
	fec = FilteredElementCollector(LinkDoc).OfCategoryId(Cat1.Id).WhereElementIsNotElementType()
	fec1 = [e.ToDSType(True) for e in fec]
	elements.append(fec1)
	tf1 = Link1[i].GetTransform()
	cs1 = CoordinateSystem.ByOriginVectors(tf1.Origin.ToPoint(True),
	tf1.BasisX.ToVector(True), tf1.BasisY.ToVector(True), tf1.BasisZ.ToVector(True))
	transforms.append(cs1)
OUT = output1(elements), output1(transforms)
# ----------------------------------------
code_block = CodeBlock(res=python_script) { res[0]; res[1]; }
elements = Output(code_block.out0)
transform_s = Output(code_block.out1)  # "transform(s)"
