# Dynamo custom node Dictionary.ByKeysValues.dyf "Springs.Dictionary.ByKeysValues" (Dynamo 1.2.1.3083)
# category: Springs.Core.List.Create
# Dictionaries are an incredibly powerful tool for making associative sets between two equal length lists. The first list must be of unique strings (or numbers) and will be the key and the second list will be the matching values (it can be made up of geometry, elements, even other lists)
# The search keys list will provide the corresponding value to the input key.

keys = Input(keys:var[])
values = Input(values:var[]..[])
searchKeys = Input(searchKeys:var[])
python_script = Python(IN[0]=keys, IN[1]=values, IN[2]=searchKeys)
# ---------- python_script.python (18 lines) ----------
#Copyright(c) 2016, Dimitar Venkov
# @5devene, dimitar.ven@gmail.com

def tolist(obj1):
	if hasattr(obj1,"__iter__"): return obj1
	else: return [obj1]

out1 = []

keys = tolist(IN[0])
elements = tolist(IN[1])
searchVals = tolist(IN[2])
dict1 = dict(zip(keys,elements))
for i in xrange(len(searchVals)):
	if searchVals[i] in dict1: out1.append(dict1[searchVals[i]])
	else: out1.append(None)

OUT = out1
# ----------------------------------------
result = Output(python_script)
