# Dynamo custom node DirectShape.Transform.dyf (Dynamo 0.8.2.2392)
# category: SpringNodes.Revit.DirectShape
# Copy the input DirectShape element with the help of a translation vector, similarly to the Geometry.Translate node. This method should prove much faster than Element.Copy

direct_shape = Input()
vector_s = Input()  # "vector(s)"
python_script = Python(IN[0]=direct_shape, IN[1]=vector_s)
# ---------- python_script.python (53 lines) ----------
#Copyright(c) 2016, Dimitar Venkov
# @5devene, dimitar.ven@gmail.com

import clr

clr.AddReference("RevitServices")
import RevitServices
from RevitServices.Persistence import DocumentManager
from RevitServices.Transactions import TransactionManager
doc = DocumentManager.Instance.CurrentDBDocument

clr.AddReference("RevitNodes")
import Revit
clr.ImportExtensions(Revit.Elements)
clr.ImportExtensions(Revit.GeometryConversion)

clr.AddReference("RevitAPI")
from Autodesk.Revit.DB import *

def tolist(obj1):
	if hasattr(obj1,"__iter__"): return obj1
	else: return [obj1]

def output1(l1):
	if len(l1) == 1: return out1[0]
	else: return l1

dsTyped = UnwrapElement(IN[0])
vecs = tolist(IN[1])

cat = dsTyped.Category
TypeId = dsTyped.GetTypeId()
Lib_TypeId = TypeId.ToString()
transforms = []
for i in xrange(len(vecs)):
	try: transforms.append(Transform.CreateTranslation(vecs[i].ToXyz(True)))
	except: pass
	
def CopyDS(cat, TypeId, Lib_TypeId, transforms):
	out1 = []
	dsLib = DirectShapeLibrary.GetDirectShapeLibrary(doc)
	if not dsLib.ContainsType(Lib_TypeId): dsLib.AddDefinitionType(Lib_TypeId, TypeId)
	for i in xrange(len(transforms)):
		try:
			ds1 = DirectShape.CreateElementInstance(doc, TypeId, cat.Id, Lib_TypeId, transforms[i], "Dynamo","")
			ds1.SetTypeId(TypeId)
			out1.append(ds1.ToDSType(False))
		except: out1.append([])
	return out1
	
TransactionManager.Instance.EnsureInTransaction(doc)
OUT = output1(CopyDS(cat, TypeId, Lib_TypeId, transforms))
TransactionManager.Instance.TransactionTaskDone()
# ----------------------------------------
direct_shape_s = Output(python_script)  # "direct shape(s)"
