# Dynamo custom node Doc.DeleteElements.dyf (Dynamo 0.8.2.2392)
# category: SpringNodes.Revit.Document
# Attempts to delete the input revit elements and returns the number of successfully deleted elements. Carefully observe the deleted elements count. It may be greater than the input list because hosted elements or tags will be deleted as well.

element_s = Input()  # "element(s)"
python_script = Python(IN[0]=element_s)
# ---------- python_script.python (37 lines) ----------
#Copyright(c) 2015, Dimitar Venkov
# @5devene, dimitar.ven@gmail.com

import clr

clr.AddReference("RevitServices")
import RevitServices
from RevitServices.Persistence import DocumentManager
from RevitServices.Transactions import TransactionManager
doc = DocumentManager.Instance.CurrentDBDocument

clr.AddReference("RevitAPI")
from Autodesk.Revit.DB import ElementId

from System.Collections.Generic import *

def tolist(obj1):
	if hasattr(obj1,"__iter__"):
		return obj1
	else:
		return [obj1]

elements = UnwrapElement(tolist(IN[0]))

idsToDelete = List[ElementId]()
for i in elements:
	try:
		idsToDelete.Add(i.Id)
	except:
		pass
s1 = ""
TransactionManager.Instance.EnsureInTransaction(doc)
deleted = doc.Delete(idsToDelete)
TransactionManager.Instance.TransactionTaskDone()
for d in deleted:
	s1 = s1 + str(d) + ";"
OUT = len(deleted),s1
# ----------------------------------------
code_block = CodeBlock(d=python_script) { d[0]; d[1]; }
count = Output(code_block.out0)
ids_str = Output(code_block.out1)  # "ids(str)"
