# Dynamo custom node Element.Copy.dyf "Springs.Element.Copy" (Dynamo 1.1.1.1841)
# category: Springs.Revit.Element
# WARNING: Do not use this node in Automatic mode! Copy (planar array) the input Revit elements with the help of a translation vector, similarly to the Geometry.Translate node.

element = Input(element:var)
vector = Input(vector:var)
python_script = Python(IN[0]=element, IN[1]=vector)
# ---------- python_script.python (30 lines) ----------
#Copyright(c) 2016, Dimitar Venkov
# @5devene, dimitar.ven@gmail.com

import clr

clr.AddReference("RevitServices")
import RevitServices
from RevitServices.Persistence import DocumentManager
from RevitServices.Transactions import TransactionManager
doc = DocumentManager.Instance.CurrentDBDocument

clr.AddReference("RevitNodes")
import Revit
clr.ImportExtensions(Revit.Elements)
clr.ImportExtensions(Revit.GeometryConversion)

clr.AddReference("RevitAPI")
from Autodesk.Revit.DB import *

ele = UnwrapElement(IN[0])
vec = tolist(IN[1])

try:
	TransactionManager.Instance.EnsureInTransaction(doc)
	newId = ElementTransformUtils.CopyElement(doc, ele.Id, vec.ToXyz(True) )
	TransactionManager.Instance.TransactionTaskDone()
	res1 = [doc.GetElement(newId[i]).ToDSType(False) for i in xrange(len(newId) )]
except: res1 = []

OUT = res1
# ----------------------------------------
element_s = Output(python_script)  # "element(s)"
