# Dynamo custom node Element.SetLocation.dyf (Dynamo 0.8.2.2392)
# category: SpringNodes.Revit.Utility
# Attempts to modify the location of the input element.. This can effectively add as a move comand in Revit. Works for both line based and point based elements.

element_s = Input()  # "element(s)"
location_s = Input()  # "location(s)"
python_script = Python(IN[0]=element_s, IN[1]=location_s)
# ---------- python_script.python (56 lines) ----------
#Copyright(c) 2015, Dimitar Venkov
# @5devene, dimitar.ven@gmail.com

import clr

clr.AddReference("RevitServices")
import RevitServices
from RevitServices.Persistence import DocumentManager
from RevitServices.Transactions import TransactionManager
doc =  DocumentManager.Instance.CurrentDBDocument

clr.AddReference("RevitNodes")
import Revit
clr.ImportExtensions(Revit.Elements)
clr.ImportExtensions(Revit.GeometryConversion)

clr.AddReference("RevitAPI")
from Autodesk.Revit.DB import LocationCurve, LocationPoint, Wall, WallUtils

def tolist(obj1):
	if hasattr(obj1,"__iter__"):
		return obj1
	else:
		return [obj1]

elements = UnwrapElement(tolist(IN[0]))
newloc = UnwrapElement(tolist(IN[1]))
out1 = []

TransactionManager.Instance.EnsureInTransaction(doc)

for e,l in zip(elements, newloc):
	try:
		iswall = False
		if e.GetType() == Wall:
			WallUtils.DisallowWallJoinAtEnd(e,0)
			WallUtils.DisallowWallJoinAtEnd(e,1)
			iswall = True
		newloc = l.ToRevitType()
		oldloc = e.Location
		if oldloc.GetType() == LocationCurve:
			oldloc.Curve = newloc
		if oldloc.GetType() == LocationPoint:
			oldloc.Point = newloc
		if iswall:
			WallUtils.AllowWallJoinAtEnd(e,0)
			WallUtils.AllowWallJoinAtEnd(e,1)
		out1.append(e.ToDSType(True))
	except:
		out1.append([])
TransactionManager.Instance.TransactionTaskDone()

if len(out1) == 1 :
	OUT = out1[0]
else:
	OUT = out1
# ----------------------------------------
element_s_2 = Output(python_script)  # "element(s)"
