# Dynamo custom node ElementType.Instances.dyf "Springs.ElementType.Instances" (Dynamo 1.3.1.1736)
# category: Springs.Revit.ElementType
# Fetches all instances of the input element type

type = Input(type:var[])
python_script = Python(IN[0]=type)
# ---------- python_script.python (38 lines) ----------
import clr
clr.AddReference('RevitAPI')
from Autodesk.Revit.DB import *

clr.AddReference("RevitServices")
import RevitServices
from RevitServices.Persistence import DocumentManager
doc = DocumentManager.Instance.CurrentDBDocument

clr.AddReference('RevitNodes')
import Revit
clr.ImportExtensions(Revit.Elements)

from System.Collections.Generic import List

def tolist(x):
	if hasattr(x,'__iter__'): return x
	else : return [x]

types = UnwrapElement(tolist(IN[0]) )

catNames = set([t.Category.Name for t in types])
catId = List[ElementId]()
allCats = doc.Settings.Categories
for cn in catNames:
	if allCats.Contains(cn):
		catId.Add(allCats[cn].Id)

type_storage = dict()
fec = FilteredElementCollector(doc).WhereElementIsNotElementType().WherePasses(ElementMulticategoryFilter(catId) )
for e in fec:
	id1 = e.GetTypeId().IntegerValue
	if id1 in type_storage:
		type_storage[id1].append(e.ToDSType(True) )
	else:
		type_storage[id1] = [e.ToDSType(True)]

OUT = [type_storage[t.Id.IntegerValue] for t in types]
# ----------------------------------------
instances = Output(python_script)
