# Dynamo custom node FamilyInstance.ByGeometry.dyf (Dynamo 4.0.2.3852)
# category: Springs.Revit.Create
# You must provide a valid family template path that will be used for all input geometry objects. The project units(and not the templates) will be used to determine the size of the output geometry.
# The provided category will be used only if the family template supports it. If not, the default template category will be used instead.
# Likewise, the family material(provided as a string) will be set only if a material with that name exists in the template. If not, the default material will be used instead ("By Category").
# For void cuts, the material settings will be ignored.
# The Subcategory name is an optional input. If you'd like to skip assigning a Subcategory to any new instance, simply use null.
# The node expects a unique family name for each geometry object. The rest of the input lists will be processed as if the node lacing is set to longest.

geometry = Input(geometry: var[])
familyTemplatePath = Input(familyTemplatePath: var)
familyName = Input(familyName: var[])
category = Input(category: var[] = Revit.Elements.Category.ByName("OST_GenericModel"))
materialName = Input(materialName: var[] = null)
isVoid = Input(isVoid: var[] = false)
subcategoryName = Input(subcategoryName: var[] = null)
python_script = Python(IN[0]=geometry, IN[1]=familyTemplatePath, IN[2]=familyName, IN[3]=category, IN[4]=materialName, IN[5]=isVoid, IN[6]=subcategoryName)  # PythonNet3
# ---------- python_script.python (196 lines) ----------
#----------------------------------------------#
#                                              #
#      Copyright(c) 2016, Dimitar Venkov       #
#                                              #
# https://github.com/dimven/SpringNodes/issues #
# https://www.reope.com/                       #
#                                              #
#    ____    _____   _____   ____    _____     #
#   |  _ \ *|  ___|*|  _  |*|  _ \ *|  ___|    #
#   | |_) |*| |___ *| | | |*| |_) |*| |___     #
#   |  _ < *|  ___|*| | | |*|  __/ *|  ___|    #
#   | | | |*| |___ *| |_| |*| |    *| |___     #
#   |_| \_|*|_____|*|_____|*|_|    *|_____|    #
#                                              #    
#                                              #
#-----------Updated by Mark Ackerley-----------#

import clr
import System
from System.Collections.Generic import *
from itertools import repeat
import uuid
import traceback

clr.AddReference('ProtoGeometry')
from Autodesk.DesignScript.Geometry import Geometry as DynGeom
from Autodesk.DesignScript.Geometry import Point as DynPoint
from Autodesk.DesignScript.Geometry import Vector, BoundingBox

clr.AddReference('RevitServices')
from RevitServices.Persistence import DocumentManager
from RevitServices.Transactions import TransactionManager

clr.AddReference('RevitAPI')
from Autodesk.Revit.DB import (
    FilteredElementCollector, View, SATImportOptions,
    ImportPlacement, ImportUnit, Options, SaveAsOptions,
    FreeFormElement, BuiltInParameter, Material,
    ElementId, UnitUtils, XYZ, ElementTransformUtils,
    ForgeTypeId, IFamilyLoadOptions
)
from Autodesk.Revit.DB.Structure import StructuralType

doc = DocumentManager.Instance.CurrentDBDocument

def tolist(obj1):
    if hasattr(obj1, '__iter__') and not isinstance(obj1, str):
        return obj1
    return [obj1]

def PadLists(lists):
    len1 = len(lists[0])
    for i in range(1, len(lists)):
        len2 = len(lists[i])
        if len2 == len1:
            continue
        elif len2 > len1:
            lists[i] = lists[i][:len1]
        else:
            lists[i].extend(repeat(lists[i][-1], len1 - len2))
    return lists

class FamOpt1(IFamilyLoadOptions):
    __namespace__ = "FamOpt_" + str(uuid.uuid4()).replace('-', '')

    def __init__(self):
        super().__init__()

    def OnFamilyFound(self, familyInUse, overwriteParameterValues):
        overwriteParameterValues = True
        return (True, overwriteParameterValues)

    def OnSharedFamilyFound(self, sharedFamily, familyInUse, source, overwriteParameterValues):
        overwriteParameterValues = True
        return (True, overwriteParameterValues)

geom     = tolist(IN[0])
fam_path = IN[1]
names    = tolist(IN[2])
category = tolist(IN[3])
material = tolist(IN[4])
isVoid   = tolist(IN[5])
subcat   = tolist(IN[6])

if int(doc.Application.VersionNumber) > 2021:
    units = doc.GetUnits().GetFormatOptions(ForgeTypeId("autodesk.spec.aec:length")).GetUnitTypeId()
else:
    units = doc.GetUnits().GetFormatOptions(UnitType.UT_Length).DisplayUnits

factor = UnitUtils.ConvertToInternalUnits(1, units)
acceptable_views = ('ThreeD', 'FloorPlan', 'EngineeringPlan', 'CeilingPlan', 'Elevation', 'Section')
origin = XYZ.Zero
str_typ = StructuralType.NonStructural
t1 = TransactionManager.Instance
temp_path = System.IO.Path.GetTempPath()
invalid_chars = System.IO.Path.GetInvalidFileNameChars()
satOpt = SATImportOptions()
satOpt.Placement = ImportPlacement.Origin
satOpt.Unit = ImportUnit.Foot
opt1 = Options()
opt1.ComputeReferences = True
SaveAsOpt = SaveAsOptions()
SaveAsOpt.OverwriteExistingFile = True

def NewForm_background(s1, name1, cat1, isVoid1, mat1, subcat1):
    try:
        enable_mat = False if mat1 is None else True
        enable_subcat = False if subcat1 is None else True
        if any(c in name1 for c in invalid_chars):
            raise Exception('Family name contains invalid characters')
        TransactionManager.ForceCloseTransaction(t1)
        famdoc = doc.Application.NewFamilyDocument(fam_path)
        sat_path = '%s%s.sat' % (temp_path, name1)
        if factor != 1:
            s1 = s1.Scale(factor)
        vec1 = Vector.ByTwoPoints(BoundingBox.ByGeometry([s1]).MinPoint, DynPoint.Origin())
        s1 = s1.Translate(vec1)
        sat1 = DynGeom.ExportToSAT([s1], sat_path)
        view_fec = FilteredElementCollector(famdoc).OfClass(View)
        view1 = next((v for v in view_fec if str(v.ViewType) in acceptable_views and not v.IsTemplate), None)
        t1.EnsureInTransaction(famdoc)
        satId = famdoc.Import(sat1, satOpt, view1)
        el1 = famdoc.GetElement(satId)
        geom1 = el1.get_Geometry(opt1)
        enum = geom1.GetEnumerator()
        enum.MoveNext()
        geom2 = enum.Current.GetInstanceGeometry()
        enum2 = geom2.GetEnumerator()
        enum2.MoveNext()
        s1 = enum2.Current
        System.IO.File.Delete(sat_path)
        save_path = '%s%s.rfa' % (temp_path, name1)
        try:
            fam_cat = famdoc.Settings.Categories.get_Item(cat1.Name)
            famdoc.OwnerFamily.FamilyCategory = fam_cat
        except Exception:
            pass
        s2 = FreeFormElement.Create(famdoc, s1)
        if isVoid1:
            s2.get_Parameter(BuiltInParameter.ELEMENT_IS_CUTTING).Set(1)
            famdoc.OwnerFamily.get_Parameter(BuiltInParameter.FAMILY_ALLOW_CUT_WITH_VOIDS).Set(1)
        else:
            if enable_mat:
                try:
                    mat_fec = FilteredElementCollector(famdoc).OfClass(Material)
                    for m in mat_fec:
                        if m.Name == mat1:
                            fam_mat = m
                            break
                    s2.get_Parameter(BuiltInParameter.MATERIAL_ID_PARAM).Set(fam_mat.Id)
                except Exception:
                    pass
            if enable_subcat:
                try:
                    current_fam_cat = famdoc.OwnerFamily.FamilyCategory
                    fam_cat_subs = current_fam_cat.SubCategories
                    if fam_cat_subs.Contains(subcat1):
                        new_subcat = fam_cat_subs[subcat1]
                    else:
                        new_subcat = famdoc.Settings.Categories.NewSubcategory(current_fam_cat, subcat1)
                    s2.Subcategory = new_subcat
                except Exception:
                    pass
        TransactionManager.ForceCloseTransaction(t1)
        famdoc.SaveAs(save_path, SaveAsOpt)
        family1 = famdoc.LoadFamily(doc, FamOpt1())
        famdoc.Close(False)
        System.IO.File.Delete(save_path)
        symbols = family1.GetFamilySymbolIds().GetEnumerator()
        symbols.MoveNext()
        symbol1 = doc.GetElement(symbols.Current)
        t1.EnsureInTransaction(doc)
        if not symbol1.IsActive:
            symbol1.Activate()
        inst1 = doc.Create.NewFamilyInstance(origin, symbol1, str_typ)
        rev_vec = XYZ(-vec1.X, -vec1.Y, -vec1.Z)
        ElementTransformUtils.MoveElement(doc, inst1.Id, rev_vec)
        TransactionManager.ForceCloseTransaction(t1)
        return inst1, family1

    except Exception as e:
        return traceback.format_exc(), ''

if len(geom) == len(names) == len(category) == len(isVoid) == len(material) == len(subcat):
    return1 = list(map(NewForm_background, geom, names, category, isVoid, material, subcat))
elif len(geom) == len(names):
    padded = PadLists([geom, category, isVoid, material, subcat])
    p_category, p_isVoid, p_material, p_subcat = padded[1], padded[2], padded[3], padded[4]
    return1 = list(map(NewForm_background, geom, names, p_category, p_isVoid, p_material, p_subcat))
else:
    return1 = [('Make sure that each geometry\nobject has a unique family name.', '')]

OUT = [i[0] for i in return1], [i[1] for i in return1]
satOpt.Dispose()
opt1.Dispose()
SaveAsOpt.Dispose()
# ----------------------------------------
code_block = CodeBlock(res=python_script) { res[0]; res[1]; }
instance = Output(code_block.out0)
family = Output(code_block.out1)
