# Dynamo custom node Feet2Fraction.dyf "Springs.Feet2Fraction" (Dynamo 1.0.0.1180)
# category: Springs.Core.Units
# Converts a decimal foot value to a fractional foot/inch string.

code_block = CodeBlock()
# ---------- code_block.designscript (22 lines) ----------
def ft2frac(x,frac:var[],f1){
ft1 = Math.Floor(x);
in1 = (x - ft1)*12;
in2 = Math.Floor(in1);
fr1 = (in1 - in2) * frac;
fr2 = Math.Round(fr1);
v1 = Math.Abs(fr1 - fr2);
ind1 = List.FirstIndexOf(v1,
List.MinimumItem(v1));
fr3 = __Apply(f1,fr2[ind1])
+ "/" + __Apply(f1,frac[ind1]);
ft1s = __Apply(f1,ft1) + "'";
in2s = __Apply(f1,in2);
ft1s = ft1s == "0'" ? "" : ft1s;
t1 = in2 == 0;
t2 = fr3 == "0/2";
in2s = t1 ? "" : in2s;
fr3s = t2 ? "" : fr3;
mid = t1 || t2 ? "" : " ";
end = t1 && t2 ? "" : "\"";
return = ft1s+in2s+mid+fr3s+end;
};
# ----------------------------------------
number = Input(number:var)
mul = _ * _
code_block_2 = CodeBlock { 2; List.Cycle(2,7); }
scan = ScanList(mul, code_block_2.out0, code_block_2.out1)  # "List.Scan"
toString = Custom[Number.ToString]()  # Converts the input number(s) to string. Can process lists.
code_block_3 = CodeBlock(x=number, frac=scan, f1=toString) { ft2frac(x,frac,f1); }
fraction_str = Output(code_block_3)  # "fraction(str)"
