# Dynamo custom node File.Size.dyf (Dynamo 0.8.2.2392)
# category: SpringNodes.Misc
# Checks the file size. Provide a file path as a string.

path_s = Input()  # "path(s)"
file_size = Python(IN[0]=path_s)
# ---------- file_size.python (20 lines) ----------
#Copyright(c) 2015, Dimitar Venkov
# @5devene, dimitar.ven@gmail.com

import clr
import sys
sys.path.append('C:\Program Files (x86)\IronPython 2.7\Lib')
import os

def tolist(obj1):
	if hasattr(obj1,"__iter__"):
		return obj1
	else:
		return [obj1]
paths = tolist(IN[0])
size = [os.stat(p).st_size for p in paths]
size_f = [str(int(s)/1024) + " KB" for s in size]
if len(size) == 1:
	OUT = size_f[0]
else:
	OUT = size_f
# ----------------------------------------
size = Output(file_size)
