# Dynamo custom node Filter.ByCategoryName.dyf (Dynamo 0.8.2.2392)
# category: SpringNodes.Revit.Utility
# Filters the input elements by their category name. You can input multiple category names.

element_s = Input()  # "element(s)"
category_name_s = Input()  # "category name(s)"
python_script = Python(IN[0]=element_s, IN[1]=category_name_s)
# ---------- python_script.python (29 lines) ----------
#Copyright(c) 2015, Dimitar Venkov
# @5devene, dimitar.ven@gmail.com

import clr

clr.AddReference("RevitNodes")
import Revit
clr.ImportExtensions(Revit.Elements)

def tolist(obj1):
	if hasattr(obj1,"__iter__"):
		return obj1
	else:
		return [obj1]

elements = tolist(IN[0])
filter = tolist(IN[1])
in1, out1 = [], []

for e in elements:
	try:
		n1 = UnwrapElement(e).Category.Name.lower()
	except:
		n1 = ""
	if any(f.lower() in n1 for f in filter):
		in1.append(e)
	else:
		out1.append(e)
OUT = in1, out1
# ----------------------------------------
code_block = CodeBlock(f=python_script) { f[0]; f[1]; }
in_ = Output(code_block.out0)  # "in"
out = Output(code_block.out1)
