# Dynamo custom node FloorOpening.ByCurves.dyf (Dynamo 0.8.2.2392)
# category: SpringNodes.Revit.Openings
# Create hosted floor opeinngs through the input floors. The second input is a list of sub-lists of the boundary curves.

host_floor_s = Input()  # "host floor(s)"
CurveSublists = Input()  # "CurveSublists [][]"
python_script = Python(IN[0]=host_floor_s, IN[1]=CurveSublists)
# ---------- python_script.python (57 lines) ----------
#Copyright(c) 2015, Dimitar Venkov
# @5devene, dimitar.ven@gmail.com

import clr

clr.AddReference("RevitAPI")
from Autodesk.Revit.DB import *

clr.AddReference("RevitServices")
import RevitServices
from RevitServices.Persistence import DocumentManager
from RevitServices.Transactions import TransactionManager
doc =  DocumentManager.Instance.CurrentDBDocument

clr.AddReference("RevitNodes")
import Revit
clr.ImportExtensions(Revit.Elements)
clr.ImportExtensions(Revit.GeometryConversion)

def tolist(obj1):
	if hasattr(obj1,"__iter__"):
		return obj1
	else:
		return [obj1]

flr = UnwrapElement(tolist(IN[0]))
hole = UnwrapElement(IN[1])

openings = []
newhl = []

if not any(hasattr(h,"__iter__") for h in hole):
	hole = [hole]
TransactionManager.Instance.EnsureInTransaction(doc)
for i in xrange(len(hole)):
	z = CurveArray()
	[z.Append(j.ToRevitType()) for j in hole[i] ]
	newhl.append(z)
if len(flr) == 1 :
	for h in newhl:
		try:
			x = doc.Create.NewOpening(flr[0],h,True)
			openings.append(x.ToDSType(False))
		except:
			openings.append([])
else:
	for f, h in zip(flr, newhl):
		try:
			x = doc.Create.NewOpening(f,h,True)
			openings.append(x.ToDSType(False))
		except:
			openings.append([])
TransactionManager.Instance.TransactionTaskDone()
if len(openings) == 1:
	OUT = openings[0]
else:
	OUT = openings
# ----------------------------------------
Opening = Output(python_script)
