# Dynamo custom node Geometry.Extents.dyf (Dynamo 3.3.0.6316)
# category: Springs.Geometry.Query
# Gets the dimensions of the geometry's bounding box.

geometry = Input(geometry: var)
code_block = CodeBlock(g=geometry)
# ---------- code_block.designscript (8 lines) ----------
s1 = DSCore.Object.Type(g);
t1 = DSCore.String.Contains(s1, "BoundingBox");
bb = t1 ? g : BoundingBox.ByGeometry(g);
min = bb.MinPoint;
max = bb.MaxPoint;
w = DSCore.Math.Abs(min.X - max.X);
l = DSCore.Math.Abs(min.Y - max.Y);
h = DSCore.Math.Abs(min.Z - max.Z);
# ----------------------------------------
width = Output(code_block.w)
length = Output(code_block.l)
height = Output(code_block.h)
