# Dynamo custom node Geometry.IndexByDistance.dyf "Springs.Geometry.IndexByDistance" (Dynamo 1.2.2.373)
# category: Springs.Geometry
# Provides the index of the closest or farthest geometry. Should prove much faster than getting the geometry and finding its index in two separate operations.

geometry = Input(geometry:var)
other = Input(other:var[])
isClosest = Input(isClosest:bool = true)
python_script = Python(IN[0]=geometry, IN[1]=other, IN[2]=isClosest)
# ---------- python_script.python (25 lines) ----------
# Copyright(c) 2017, Dimitar Venkov
# @5devene, dimitar.ven@gmail.com
# www.badmonkeys.net

from operator import itemgetter

def singleton(x):
	if hasattr(x,'__iter__'): return x[0]
	else : return x

def tolist(x):
	if hasattr(x,'__iter__'): return x
	else : return [x]

geom = singleton(IN[0])
other = tolist(IN[1])
isClosest = singleton(IN[2])

_fn = min if isClosest else max
_getter = itemgetter(1)
def dist_(x, geom = geom, _getter=_getter):
	return geom.DistanceTo(_getter(x) )

ind, _ = _fn(enumerate(other), key=dist_)
OUT = ind
# ----------------------------------------
index = Output(python_script)
