# Dynamo custom node Geometry.SplitRecursively.dyf "Springs.Geometry.SplitRecursively" (Dynamo 1.2.1.3083)
# category: Springs.Geometry
# Splits a surface or a solid recursively, using the resulting reduced geometry for every consecutive split. Select a point or another geometry to control the direction of the split.

code_block = CodeBlock()
# ---------- code_block.designscript (20 lines) ----------
def splitface1(face, planes:var[],dir1){
return = [Imperative]{
 out1 = {};
 for (p in planes){
  s1 = face.Split(p);
  if(Count(s1) < 2){
   face = s1[0];
   continue;
  }
  ind1 = SortIndexByValue(
   dir1.DistanceTo(s1) );
  s1 = Reorder(s1,ind1);
  face = s1[0];
  s2 = s1[1];
  out1 = Flatten({out1,s2});
 }
 out1 = Flatten({out1, face});
 return = out1;
}
};
# ----------------------------------------
geometry = Input(geometry:var)
tools = Input(tools:var[])
pickPoint = Input(pickPoint:var)
code_block_2 = CodeBlock(face=geometry, tools=tools, dir1=pickPoint) { splitface1(face, tools,dir1); }
geometry_2 = Output(code_block_2)  # "geometry[]"
