# Dynamo custom node List.GetEven.dyf (Dynamo 0.7.6.4045)
# category: SpringNodes.Lists
# Gets even indices from the list.

list = Input()
code_block = CodeBlock(l1=list) { List.TakeEveryNthItem(l1,2,0); }
list_2 = Output(code_block)  # "list"
