# Dynamo custom node List.Split.dyf (Dynamo 0.8.2.2392)
# category: SpringNodes.Lists
# Splits a list at the desired length

list = Input(list:var[])
amount = Input(amount:int)
code_block = CodeBlock(l1=list, amt=amount) { List.TakeItems(l1, amt); List.DropItems(l1, amt); }
list1 = Output(code_block.out0)
list2 = Output(code_block.out1)
