# Dynamo custom node Ln2Str.dyf "Springs.Ln2Str" (Dynamo 0.8.2.2392)
# category: Springs.Geometry.Serialization
# Serilize a geometry line to a string for use in Revit parameters

line = Input(line:var)
code_block = CodeBlock(line)
# ---------- code_block.designscript (11 lines) ----------
def Pt2Rvt(p1)
{
return = p1.X + "," + p1.Y + "," + p1.Z;
};

def Ln2Rvt(l1)
{
return = Pt2Rvt(l1.StartPoint) + "," + Pt2Rvt(l1.EndPoint);
};

Ln2Rvt(cl);
# ----------------------------------------
string = Output(code_block)
