# Dynamo custom node NullGetParameter.dyf "Springs.NullGetParameter" (Dynamo 1.3.2.2480)
# category: Springs.Revit.Element
# Similar to the built in node.Capable of handling null values, part of the SmartCopyMonitor workflow.

element = Input(element:var)
parameter = Input(parameter:var)
code_block = CodeBlock(element, parameter)
# ---------- code_block.designscript (8 lines) ----------
e1;
par;
value = [Imperative]{
if (e1 != null)
{
return = e1.GetParameterValueByName(par);
}
};
# ----------------------------------------
value = Output(code_block.out2)
