# Dynamo custom node NullSetParameter.dyf "Springs.NullSetParameter" (Dynamo 1.3.2.2480)
# category: Springs.Revit.Element
# Similar to the built-in function but with the ability to handle null values. Part of the SmartCopyMon workflow.

element = Input(element:var)
parameter = Input(parameter:var)
value = Input(value:var)
code_block = CodeBlock(element, parameter, value)
# ---------- code_block.designscript (9 lines) ----------
e1;
par;
val;
element = [Imperative]{
if (e1 != null)
{
return = e1.SetParameterByName(par,val);
}
};
# ----------------------------------------
element_2 = Output(code_block.out3)  # "element"
