# Dynamo custom node Number.ToString.dyf "Springs.Number.ToString" (Dynamo 1.3.1.1736)
# category: Springs.Core.String.Actions
# Converts the input number(s) to string. You can optionally limit the number of digits.

num = Input(num:var[])
digits = Input(digits:int = null)
python_script = Python(IN[0]=num, IN[1]=digits)
# ---------- python_script.python (19 lines) ----------
# Copyright(c) 2017, Dimitar Venkov
# @5devene, dimitar.ven@gmail.com
# www.badmonkeys.net

def tolist(x):
	if hasattr(x,'__iter__'): return x
	else : return [x]

def n2s(n, digits=IN[1]):
	if digits is not None:
		n = round(n, digits)
	s1 = str(n)
	if s1[-2:] == ".0":
		s1 = s1[:-2]
	return s1

nums = tolist(IN[0])

OUT = map(n2s, nums)
# ----------------------------------------
str = Output(python_script)
