# Dynamo custom node Pt2Str.dyf "Springs.Pt2Str" (Dynamo 0.8.2.2392)
# category: Springs.Geometry.Serialization
# Serilize a geometry point to a string for use in Revit parameters

point = Input(point:var)
code_block = CodeBlock(point)
# ---------- code_block.designscript (6 lines) ----------
def Pt2Rvt(p1)
{
return = p1.X + "," + p1.Y + "," + p1.Z;
};

Pt2Rvt(pts);
# ----------------------------------------
string = Output(code_block)
