# Dynamo custom node ScopeBox.Geometry.dyf "Springs.ScopeBox.Geometry" (Dynamo 1.3.2.2480)
# category: Springs.Revit.Utility
# Fetches the base curve and solid representation of a scope box element.

scopeBox = Input(scopeBox:var)
code_block = CodeBlock(s=scopeBox)
# ---------- code_block.designscript (6 lines) ----------
c1 = s.Geometry();
msk = Vector.ZAxis().Dot(c1.Direction) == 0;
c2 = DSCore.List.FilterByBoolMask(c1, msk)["in"];
c3 = DSCore.List.SortByKey(c2, c2.EndPoint.Z)["sorted list"];
pc1 = PolyCurve.ByJoinedCurves(c3[0..3]);
s1 = pc1.ExtrudeAsSolid(c3[4].EndPoint.Z - c3[0].EndPoint.Z);
# ----------------------------------------
polyCurve = Output(code_block.pc1)
solid = Output(code_block.s1)
