# Dynamo custom node SelectInRevit.dyf (Dynamo 0.8.2.2392)
# category: SpringNodes.Revit.Utility
# Selects the input elements in Revit. Works with Revit 2016.

element_s = Input()  # "element(s)"
python_script = Python(IN[0]=element_s)
# ---------- python_script.python (38 lines) ----------
#Copyright(c) 2015, Dimitar Venkov
# @5devene, dimitar.ven@gmail.com
#inspired by Julien Benoit @jbenoit44 
#http://aecuandme.wordpress.com/

import clr

clr.AddReference("RevitServices")
import RevitServices
from RevitServices.Persistence import DocumentManager
from RevitServices.Transactions import TransactionManager
doc = DocumentManager.Instance.CurrentDBDocument
uidoc=DocumentManager.Instance.CurrentUIApplication.ActiveUIDocument

clr.AddReference("RevitNodes")
import Revit
clr.ImportExtensions(Revit.Elements)

clr.AddReference("RevitAPI")
from Autodesk.Revit.DB import ElementId

clr.AddReference("System")
from System.Collections.Generic import List as cList

def tolist(obj1):
	if hasattr(obj1,"__iter__"):
		return obj1
	else:
		return [obj1]

elements = UnwrapElement(tolist(IN[0]))
try:
	ids1 = [e.Id for e in elements]
	ids2 = cList[ElementId](ids1)
	uidoc.Selection.SetElementIds(ids2)
	OUT = "%s elements selected in Revit." %ids2.Count
except:
	OUT = "list contains non-elements"
# ----------------------------------------
success = Output(python_script)  # "success?"
