# Dynamo custom node Sheet.Views+.dyf (Dynamo 0.8.2.2392)
# category: SpringNodes.Revit.Views
# Extracts all views placed on the input sheet(s).  Will be depreciated once the bult in node works with all plan types.

sheet_s = Input()  # "sheet(s)"
python_script = Python(IN[0]=sheet_s)
# ---------- python_script.python (37 lines) ----------
#Copyright(c) 2016, Dimitar Venkov
# @5devene, dimitar.ven@gmail.com

import clr

clr.AddReference("RevitServices")
from RevitServices.Persistence import DocumentManager
doc = DocumentManager.Instance.CurrentDBDocument
uiapp = DocumentManager.Instance.CurrentUIApplication
app = uiapp.Application

clr.AddReference("RevitNodes")
import Revit
clr.ImportExtensions(Revit.Elements)

def tolist(obj1):
	if hasattr(obj1,"__iter__"): return obj1
	else: return [obj1]

def output1(l1):
	if len(l1) == 1: return l1[0]
	else: return l1

sheets = UnwrapElement(tolist(IN[0]))
sheetviews = []

if app.VersionName == "Autodesk Revit 2014":
	for i in xrange(len(sheets)):
		viewports = [doc.GetElement(v1) for v1 in sheets[i].GetAllViewports()]
		views = [doc.GetElement(v1.ViewId) for v1 in viewports]
		sheetviews.append(views)
else:
	for i in xrange(len(sheets)):
		viewsid = sheets[i].GetAllPlacedViews()
		views = [doc.GetElement(v).ToDSType(True) for v in viewsid]
		sheetviews.append(views)
OUT = output1(sheetviews)
# ----------------------------------------
view_s = Output(python_script)  # "view(s)"
