# Dynamo graph HostedInstance sample.dyn (Dynamo 0.8.2.2392)

select_model_element = DSModelElementSelection()  # 1 picked in the model
watch = Watch(select_model_element)
location = Custom[Element.Location](Element_s=select_model_element)  # Returns the location of an element as an XYZ (or if it's line-based the start and end point of the line), along with some booleans to help filtering the results. Use this for some element types (e.g. walls or lines) that do not work with the built-in Get Family Instance Location node.
code_block = CodeBlock { 0.3..0.9..0.2; }
pointAtParameter = Curve.PointAtParameter(curve=location.Curves, param=code_block, lacing=Longest)
count = Count(pointAtParameter)
ofRepeatedItem = List.OfRepeatedItem(item=select_model_element, amount=count)
family_types = FamilyTypes("M_Window-Square Opening:0900 x 1800mm")
byPoints = Custom[HostedInstanceByPoints](host_s=ofRepeatedItem, type_s=family_types, point_s=pointAtParameter)  # Creates hosted family instances(doors/windows) at the specified points. You can feed either a single family type or a unique type for each instance.
code_block_2 = CodeBlock { "Sill Height"; 800; }
setParameterByName = Element.SetParameterByName(element=byPoints, parameterName=code_block_2.out0, value=code_block_2.out1)
code_block_3 = CodeBlock()  # //from clockwork
code_block_4 = CodeBlock()  # //I need a host for each window
